# Dynamo graph script.dyn (Dynamo 2.3.2.15696)
# packages: Data-Shapes 2021.2.94, Genius Loci 2021.11.10, Clockwork for Dynamo 2.x 2.4.0, Orchid 200.4.0.7938, spring nodes 210.1.1, Crumple 2022.2.13

code_block = CodeBlock { "ji.nunezn@live.cl"; }
byUnion = Solid.ByUnion()  # unwired: solids
code_block_2 = CodeBlock { "Crear Comentario"; }
code_block_3 = CodeBlock { "INICIAR"; "CANCELAR"; 500; 150; }
code_block_4 = CodeBlock { "Seleccionar los Elementos"; }
code_block_5 = CodeBlock { "SELECCIONAR"; }
selectmodelelements_data_ordered = Custom[SelectModelElements Data (ordered)](InputName=code_block_4, ButtonText=code_block_5)  # package Data-Shapes; Creates a Revit element selection input for UI.MultipleInputForm++ . Check out www.data-shapes.net for more infos!
code_block_6 = CodeBlock { "Escribir Comentario"; }
textbox_data = Custom[TextBox Data](InputName=code_block_6)  # package Data-Shapes; Create Data for TextBox input in UI.MultipleInputForm ++ . Check out www.data-shapes.net for more informations
list_create = List.Create(item0=selectmodelelements_data_ordered, item1=textbox_data)
inputgroup_data = Custom[InputGroup Data](Inputs=list_create)  # package Data-Shapes; Creates a group of inputs for UI.MultipleInputForm ++ . Check out www.data-shapes.net for more infos !
boolean = BoolSelector(true)
multipleinputform = Custom[MultipleInputForm ++](Description_optional=code_block_2, ButtonText_optional=code_block_3.out0, Inputs=inputgroup_data, Toggle=boolean, CancelButtonText_optional=code_block_3.out1, Width_optional=code_block_3.out2, LabelWidth_optional=code_block_3.out3)  # package Data-Shapes; Create a form with multiple inputs. see www.data-shapes.net for tutorials and infos!
code_block_7 = CodeBlock(x=multipleinputform.User_Inputs)
# ---------- code_block_7.designscript (24 lines) ----------
x;
[Imperative]
{
	if(x == null)
	{
		return = [];
	}
	else
	{
		return = x[0];
	}
};

[Imperative]
{
	if(x == null)
	{
		return = [];
	}
	else
	{
		return = x[1];
	}
};
# ----------------------------------------
code_block_8 = CodeBlock(x=code_block_7.out1) { x; }
geometry = Element.Geometry(element=code_block_8)
flatten = List.Flatten(list=geometry)
function_apply = ApplyFunction(func=byUnion, arg1=flatten)
code_block_9 = CodeBlock(x=function_apply)
# ---------- code_block_9.designscript (12 lines) ----------
x;
[Imperative]
{
	if(x == null)
	{
		return = [];
	}
	else
	{
		return = x;
	}
};
# ----------------------------------------
boundingBox = Geometry.BoundingBox(geometry=code_block_9.out1)
code_block_10 = CodeBlock { 2; }
ꟿ_boundingbox_scale = Custom[ꟿ BoundingBox.Scale](boundingBox=boundingBox, xAmmount=code_block_10, yAmmount=code_block_10, zAmmount=code_block_10)  # package spring nodes; Scales the bounding box in three dimensions according to it's center.
firstItem = List.FirstItem()  # unwired: list
workset = Custom[Element.Workset](element=code_block_8)  # package Clockwork for Dynamo 2.x; Retrieves the workset of a given element
toOrchidType = Orchid.RevitProject.Common.Workset.ToOrchidType(workset=workset)
name = Orchid.RevitProject.Common.Workset.Name(workset=toOrchidType)
function_apply_2 = ApplyFunction(func=firstItem, arg1=name)
n3dview_collector = Custom[3DView Collector]()  # package Genius Loci; Retrieves the 3D views in the active or given document.
name_2 = Element.Name(element=n3dview_collector)
code_block_11 = CodeBlock { "_"; }
split = String.Split(str=name_2, separator0=code_block_11)
code_block_12 = CodeBlock { 0; }
getItemAtIndex = List.GetItemAtIndex(list=split@L2, index=code_block_12)
uniqueItems = List.UniqueItems(list=name)
eq = getItemAtIndex == uniqueItems  # lacing=Longest
countTrue = List.CountTrue(list=eq)
code_block_13 = CodeBlock(num=countTrue) { num+1; }
code_block_14 = CodeBlock(wn=function_apply_2, num=code_block_13) { wn+"_COMENTARIO "+num; }
n3dview_by_boundingbox = Custom[3DView by BoundingBox](boundingBox=ꟿ_boundingbox_scale, viewName=code_block_14)  # package Genius Loci; Use a boundingbox to create a new 3D View with a specified name. Note: Use the "Remove Special Characters from String" node to obtain a view name without prohibited characters.
code_block_15 = CodeBlock { "Comentario"; }
setParameterByName = Element.SetParameterByName(element=n3dview_by_boundingbox, parameterName=code_block_15, value=code_block_7.out2)
code_block_16 = CodeBlock { "Estatus Comentario"; 0; }
setParameterByName_2 = Element.SetParameterByName(element=setParameterByName, parameterName=code_block_16.out0, value=code_block_16.out1)
code_block_17 = CodeBlock(x=code_block_7.out1) { x; }
code_block_18 = CodeBlock { "<Solid fill>"; }
getByName = FillPatternElement.GetByName(name=code_block_18)
color_palette = ColorPalette({R: 255, G: 69, B: 0, A: 255})
create_overridegraphicsettings = Custom[Create OverrideGraphicSettings](SurfaceForegroundPattern=getByName, SurfaceForegroundPatternColor=color_palette, CutForegroundPattern=getByName, CutForegroundPatternColor=color_palette)  # package Genius Loci; Create a OverrideGraphicSettings (All graphic inputs are optional). Unlike the OOTB OverrideGraphicSettings.ByProperties node, the Foreground and background patterns are available. Note : Prior to Revit 2019, the materials have only one surface pattern and one cut pattern.
code_block_19 = CodeBlock { false; }
view_setelementoverrides = Custom[View SetElementOverrides](view=setParameterByName_2, elements=code_block_17, overrides=create_overridegraphicsettings, hide=code_block_19, lacing=Longest)  # package Genius Loci; Overrides element graphics settings in the given view. For use with the Create OverrideGraphicSettings node. Can also be used to hide or unhide elements.
code_block_20 = CodeBlock { null; }
replaceEmptyLists = Custom[List.ReplaceEmptyLists](seq=view_setelementoverrides, Replacement=code_block_20)  # package Clockwork for Dynamo 2.x; Replaces all empty lists within a given list with a substitute
code_block_21 = CodeBlock(x=replaceEmptyLists)
# ---------- code_block_21.designscript (12 lines) ----------
x;
[Imperative]
{
	if(x == null)
	{
		return = [];
	}
	else
	{
		return = x[0];
	}
};
# ----------------------------------------
code_block_22 = CodeBlock { "View Name"; }
getParameterValueByName = Element.GetParameterValueByName(element=code_block_21.out1, parameterName=code_block_22)
ꟿ_document_centralpath = Custom[ꟿ Document.CentralPath]()  # package spring nodes; If the document is workshared, the node returns the path to the central document as a string. Otherwise a null value will be returned.
code_block_23 = CodeBlock { "\\"; }
split_2 = String.Split(str=ꟿ_document_centralpath, separator0=code_block_23)
lastItem = List.LastItem(list=split_2)
code_block_24 = CodeBlock(vN=getParameterValueByName, centralModel=lastItem) { vN+"_"+centralModel; }
code_block_25 = CodeBlock { "Comentario"; }
getParameterValueByName_2 = Element.GetParameterValueByName(element=code_block_21.out1, parameterName=code_block_25)
outlooksend = Custom[© OutlookSend](to=code_block, subject=code_block_24, body=getParameterValueByName_2)  # package Crumple; Given Outlook is open, this node will attempt to send an email to a list of recipients with a subject and body.
